# Grasshopper definition prompt.gh (Grasshopper 1.0.8)
# plug-ins: RhinoCodePluginGH

run = BooleanToggle(True)
python_3_script = Python3Script(prompt="I work from 9am to 5pm and do yoga at 9pm", run=run)  # -> json, activities, hours, metabolic_rates
# ---------- python_3_script: Python ----------
import requests
import json

url = "http://127.0.0.1:5000/extract_activities"

try:
    r = requests.post(url, json={"prompt": prompt})
    r.raise_for_status()
    activities_json = r.json()["activities"]
    activities = json.loads(activities_json)
    activities_str = [f"{a['activity']}: {a['hours']} (metabolic_rate={a['metabolic_rate']})" for a in activities]
    hours_str = [str(a["hours"]) for a in activities]
    met_rates = [a["metabolic_rate"] for a in activities]
except Exception as e:
    activities_json = str(e)
    activities_str = []
    hours_str = []
    met_rates = []


json = activities_json       # raw JSON
activities = activities_str        # human-readable
hours = hours_str             # just hours
metabolic_rates = met_rates             # just metabolic rates
# ---------- end python_3_script ----------
json = Panel(python_3_script.json)
activities = Panel(python_3_script.activities)
metabolic_rates = Panel(python_3_script.metabolic_rates)
hours = Panel(python_3_script.hours)
